# Grasshopper definition Control_UDP.gh (Grasshopper 0.9.76)
# plug-ins: Firefly.X

# Sending Frequency
timer = Timer(TimerInterval=50, Target=[c_script, pressed_2, pressed_4, pressed, pressed_3])

# ----
# Curve Motion Control
number_slider = Slider(496, range=0..1000)
start = BooleanToggle(False)
crv = Curve(<curve referenced from the Rhino model>)
c_script = CSharpScript(start=start)  # -> out, A; inputs start: Boolean
# ---------- c_script: C# ----------
    if(start)
    {
      count++;
    }
    else{count = 0;}
    A = count;
# ---------- c_script: C# additional code ----------
  double count = -1;
# ---------- end c_script ----------
divide = DivideCurve(Curve=crv, Count=number_slider, Kinks=False)  # -> Points, Tangents, Parameters
panel = Panel(c_script.A)
pdecon = Deconstruct(Point=divide.Points)  # -> XComponent, YComponent, ZComponent
item = ListItem(List=pdecon.XComponent, Index=c_script.A, Wrap=True)
item_2 = ListItem(List=pdecon.YComponent, Index=c_script.A, Wrap=True)
item_3 = ListItem(List=pdecon.ZComponent, Index=c_script.A, Wrap=True)
join = TextJoin(Text=[item, item_2, item_3], Join=" ")
panel_2 = Panel(join)

x0 = Integer(400)
y0 = Integer(-200)
z0 = Integer(0)

# ----
# Sensor Simulation
timer_2 = Timer(TimerInterval=500, Target=c_script_2)  # disabled
c_script_2 = CSharpScript()  # -> out, A
# ---------- c_script_2: C# ----------
    int n = random.Next(0, 11);
    A = n;
# ---------- c_script_2: C# additional code ----------
  Random random = new Random();
# ---------- end c_script_2 ----------
_6 = Integer(6)
random = Random(Range=Domain(0, 1), Number=_6, Seed=c_script_2.A)
panel_3 = Panel(random)
graph = GraphMapper(panel_3, x0=0, x1=1, y0=0, y1=10, container_name="Gaussian", factor=0.2522255182, mean=0.5, sdev=0.1005586684)

# ----
# ZSQD Motion Control
panel_4 = Panel("q")
pressed = IsKeyPressed(KeyToTest=panel_4)
pressed_2 = IsKeyPressed(KeyToTest="z")
pressed_3 = IsKeyPressed(KeyToTest="d")
pressed_4 = IsKeyPressed(KeyToTest="s")
panel_5 = Panel([pressed_2, pressed_4, pressed, pressed_3])
reset = Button()
gain = Slider(15, range=0..15)
x_plane = Slider(0, range=-10..10)
c_script_3 = CSharpScript(x=pressed_2, y=pressed_4, reset=reset)  # -> out, A; inputs x: Boolean, y: Boolean, reset: Boolean
# ---------- c_script_3: C# ----------
    if(!reset)
    {
      int n = 0;
      if(x){n++;}
      if(y){n--;}
      corr += n;
    }
    else
    {
      corr = 0;
    }
    A = corr;
# ---------- c_script_3: C# additional code ----------
  int corr = 0;
# ---------- end c_script_3 ----------
c_script_4 = CSharpScript(x=pressed_3, y=pressed, reset=reset)  # -> out, A; inputs x: Boolean, y: Boolean, reset: Boolean; same code as c_script_3
multiplication = Multiplication(A=[x_plane, c_script_4.A, c_script_3.A], B=gain)

addition = Addition(A=[x0, y0, z0], B=multiplication)

join_2 = TextJoin(Text=addition, Join=" ")
panel_6 = Panel(join_2)

# ----
# UDP Sending
panel_7 = Panel("4000")
udp_sender = UDPSender(Data=join_2, IPAddressOfUDPServer="172.29.1.178", UDPPort=panel_7)
